# Dynamo graph Geometry-CreatePixelTower.dyn (Dynamo 2.19.3.6394)
# author: Autodesk
# Generate a Pixelated Tower inspired by the MahanNakhon tower by Buro Ole Scheeren Architects, a mixed-use high-rise in Bangkok Thailand.
# packages: DynamoFormaBeta 1.4.3

# group: Inputs
# How we control our overall Tower dimensions. These have all been set as "isInput" on the nodal right-click context menu to ensure they show up in the Dynamo Player in Forma.
# note: Set overall dimensions of Cube modules
cube_module_dimensions = IntegerSlider(3, range=3..20 step 1)  # graph input
# note: Set overall spread of our Cube modules
cube_module_spread = IntegerSlider(7, range=5..20 step 1)  # graph input
# note: Set overall Tower Height
overall_tower_height = IntegerSlider(130, range=100..1000 step 10)  # graph input
# note: Choose distance factor to remove Cubes
cubes_removal_factor = IntegerSlider(1, range=0..4 step 0)  # graph input

# group: Define overall Tower Dimensions
setting_tower_dimensions = CodeBlock(cubeDimensions=cube_module_dimensions, cubeSpread=cube_module_spread, towerHeight=overall_tower_height)
# ---------- setting_tower_dimensions.designscript (11 lines) ----------
//Setting overall dimensions of our pixelated Cuboid
cubeDimensions;

//Setting overall XY plane size of pixelated Tower
towerSize = cubeDimensions * cubeSpread;

//Create XY range around 0,0,0 point
horizRange = -(towerSize/2)..(towerSize/2)..cubeDimensions;

//Create height range of pixelated Tower
heightRange = 0..towerHeight..cubeDimensions;
# ----------------------------------------

# group: Create Cuboid Tower
# note: Create a single cuboid, then translate it around (More performant than genreating new ones)
byLengths = Cuboid.ByLengths(width=setting_tower_dimensions.cubeDimensions, length=setting_tower_dimensions.cubeDimensions, height=setting_tower_dimensions.cubeDimensions)
identity = CoordinateSystem.Identity()
# note: Generating a three-dimensional CoordinateSystem grid
byOrigin = CoordinateSystem.ByOrigin(x=setting_tower_dimensions.horizRange, y=setting_tower_dimensions.horizRange, z=setting_tower_dimensions.heightRange, lacing=CrossProduct)
# note: Transforming Cubes generates an overall pixelated tower
transform = Geometry.Transform(geometry=byLengths, fromCoordinateSystem=identity, contextCoordinateSystem=byOrigin)

# group: Define NurbsCurve point locations
setting_curve_dimensions = CodeBlock(towerSize=setting_tower_dimensions.towerSize, cubeDimensions=setting_tower_dimensions.cubeDimensions, towerHeight=overall_tower_height)
# ---------- setting_curve_dimensions.designscript (14 lines) ----------
//Setting an overall starting value
pointDistance = (towerSize / 2) + (cubeDimensions * 2);

//Setting X value locations for our Points to wrap around tower
x = [-pointDistance, pointDistance, pointDistance,
	-pointDistance, -pointDistance, pointDistance];

//Setting Y value locations for our Points to wrap around tower
y = [-pointDistance, -pointDistance, pointDistance,
	pointDistance, -pointDistance, -pointDistance];

//Setting Z value locations for our Points to wrap around tower
z = [0, towerHeight * 0.25, towerHeight * 0.5,
	towerHeight * 0.75, towerHeight, towerHeight * 1.25];
# ----------------------------------------

# group: Create NurbsCurve for distance checking
# note: Create points from location data
byCoordinates = Point.ByCoordinates(x=setting_curve_dimensions.x, y=setting_curve_dimensions.y, z=setting_curve_dimensions.z)
# note: Generate NurbsCurve from our control points that wraps around the building as a spiral
byControlPoints = NurbsCurve.ByControlPoints(points=byCoordinates)

# group: Removing Cuboids based on proxmity to NurbsCurve
# note: Query the distance of each Cube to our NurbsCurve in order to remove Cubes within a set distance
distanceTo = Geometry.DistanceTo(geometry=transform, other=byControlPoints)
code_block = CodeBlock(cubeDimensions=setting_tower_dimensions.cubeDimensions, cubeRemovalFactor=cubes_removal_factor)
# ---------- code_block.designscript (2 lines) ----------
//Calculating distance for cube removal
cubeDimensions * cubeRemovalFactor;
# ----------------------------------------
# note: Creatte Boolean Mask based on our Cube removal factor
le = distanceTo <= code_block
# note: Split Cubes into Remain and Remove
filterByBoolMask = List.FilterByBoolMask(list=transform, mask=le)

# group: Create a single Solid
flatten = List.Flatten(list=filterByBoolMask.out)
byUnion = Solid.ByUnion(solids=flatten)

# group: Visualizing results and setting output for consumption in Forma
# The SendToFroma node is set as "isOutput" by default on the nodal right-click context menu to ensure the geometry will show up in Forma, where you can then Add it to your Forma scene.
# note: Visualizing the completed Tower
code_block_2 = CodeBlock(pixelTower=byUnion) { pixelTower; }
# note: Add Properties to the Forma Element
code_block_3 = CodeBlock { { "category": "generic"}; }
# note: Send the Geometry to Forma as an Integrate Element.
sendToForma = SendToForma(geometry=byUnion, properties=code_block_3)  # graph output
