# Dynamo graph Metrics-BuildingCostCalculator.dyn (Dynamo 2.19.3.6394)
# author: Autodesk
# Calculate the cost of Residential, Commercial and Unspecified space and a consultants percentage based on local rates.
# packages: DynamoFormaBeta 1.4.3

# group: Inputs
gia_tick_nia_untick = BoolSelector(true)  # graph input
select_building_and_site = SelectMetrics("{\"customMetrics\":[{\"id\":\"bra\",\"name\":\"BRA\",\"unitOfMeasurement\":\"SQUARE_METER\",\"functionBreakdown\":[{\"functionId\":\"residential\",\"functionName\":\"Residential\",\"functionColor\":\"#FFEAA5\",\"value\":4558.906742027155},{\"functionId\":\"commercial\",\"functionName\":\"Commercial\",\"functionColor\":\"#D8DCFF\",\"value\":4498.789893368959},{\"functionId\":\"unspecified\",\"functionName\":\"Unspecified\",\"functionColor\":\"#FFFFFF\",\"value\":0}]},{\"id\":\"bras\",\"name\":\"BRAS\",\"unitOfMeasurement\":\"SQUARE_METER\",\"functionBreakdown\":[{\"functionId\":\"residential\",\"functionName\":\"Residential\",\"functionColor\":\"#FFEAA5\",\"value\":4103.016067824436},{\"functionId\":\"unspecified\",\"functionName\":\"Unspecified\",\"functionColor\":\"#FFFFFF\",\"value\":0}]}],\"builtInMetrics\":{\"grossFloorArea\":{\"id\":\"gfa\",\"name\":\"BTA\",\"unitOfMeasurement\":\"SQUARE_METER\",\"functionBreakdown\":[{\"functionId\":\"residential\",\"functionName\":\"Residential\",\"functionColor\":\"#FFEAA5\",\"value\":5065.451935585724},{\"functionId\":\"commercial\",\"functionName\":\"Commercial\",\"functionColor\":\"#D8DCFF\",\"value\":4998.655437076623},{\"functionId\":\"unspecified\",\"functionName\":\"Unspecified\",\"functionColor\":\"#FFFFFF\",\"value\":0}]},\"siteArea\":{\"id\":\"site_area\",\"name\":\"Site Area\",\"unitOfMeasurement\":\"SQUARE_METER\",\"value\":0},\"buildingCoverage\":{\"id\":\"bc\",\"name\":\"Building Coverage\",\"unitOfMeasurement\":\"SQUARE_METER\",\"value\":2516.026843165586}},\"unitStatistics\":{\"count\":{\"id\":\"unit_count\",\"name\":\"Number of units\",\"unitOfMeasurement\":\"COUNT\",\"value\":0}},\"parkingStatistics\":{\"spots\":0,\"area\":0}}")  # graph input
residential_rate = DoubleInput(100)  # graph input
commercial_rate = DoubleInput(200)  # graph input
unspecified_rate = DoubleInput(350)  # graph input
consultant_percentage = DoubleInput(5)  # graph input

# group: Dictionary Parsing and Value Calculations
dictionary_breakdown = CodeBlock(formaMetrics=select_building_and_site)
# ---------- dictionary_breakdown.designscript (14 lines) ----------
//Get to Area Metrics from Dictionary
areaMetrics = formaMetrics
	["customMetrics"]
	["functionBreakdown"];

//Get to Functions and Values from Dictionary
functionValues = DesignScript.Dictionary.ValueAtKey(
	areaMetrics,
	["functionName", "value"]@L1<1>
	);

//Split out results into GIA and NIA
gia = List.FirstItem(functionValues@L3<1>);
nia = List.LastItem(functionValues@L3<1>);
# ----------------------------------------
if_ = RefactoredIf(test=gia_tick_nia_untick, true=dictionary_breakdown.gia, false=dictionary_breakdown.nia)
pairing_area_typologies_with = CodeBlock(ifResult=if_, resiRate=residential_rate, commRate=commercial_rate, unspRate=unspecified_rate, consultantPercentage=consultant_percentage)  # "Pairing Area typologies with Data"
# ---------- pairing_area_typologies_with.designscript (38 lines) ----------
//Define salient Area Typologies
areaTypologies = [
	"Residential",
	"Commercial",
	"Unspecified"];

//Pair typologies to Dictionary results
pairTypologies = List.FirstIndexOf(
	ifResult@L2<1>,
	areaTypologies);

//Pulling out individual Data Lists
residential = pairTypologies[0][0];
commercial = pairTypologies[0][1];
unspecified = pairTypologies[0][2];

//Calculating cost based on Area * Rate
resiCost = Math.Ceiling(
	List.LastItem(
		List.GetItemAtIndex(
			ifResult@L2<1>,
			residential)) * resiRate);
commCost = Math.Ceiling(
	List.LastItem(
		List.GetItemAtIndex(
			ifResult@L2<1>,
			commercial)) * commRate);
unspCost = Math.Ceiling(
	List.LastItem(
		List.GetItemAtIndex(
			ifResult@L2<1>,
			unspecified)) * unspRate);

//Calculating Building Costs
buildingCost = resiCost + commCost + unspCost;
consultantFee = Math.Ceiling(
	buildingCost * (consultantPercentage/100));
totalCost = Math.Ceiling(buildingCost + consultantFee);
# ----------------------------------------

# group: Outputs
# Outputs self-organized based on creation order
python_script = Python(IN[0]=pairing_area_typologies_with.resiCost)  # CPython3
# ---------- python_script.python (24 lines) ----------
# Load the Python Standard and DesignScript Libraries
import sys
import clr
import locale

def format_number(input_value):
    try:
        # Convert input to integer if it's a string
        number = int(input_value)
    except ValueError:
        return "Invalid input. Please provide a valid number or string representation of a number."

    # Set the locale to the user's default
    locale.setlocale(locale.LC_ALL, '')

    # Format the number with commas as separators
    formatted_number = locale.format_string('%d', number, grouping=True)
    
    return formatted_number

# Example usage
input_value = IN[0]
result = format_number(input_value)
OUT = "$" + result
# ----------------------------------------
residential_cost = Watch(python_script)  # graph output
python_script_2 = Python(IN[0]=pairing_area_typologies_with.commCost)  # CPython3; same code as python_script
commercial_cost = Watch(python_script_2)  # graph output
python_script_3 = Python(IN[0]=pairing_area_typologies_with.unspCost)  # CPython3; same code as python_script
unspecified_cost = Watch(python_script_3)  # graph output
python_script_4 = Python(IN[0]=pairing_area_typologies_with.buildingCost)  # CPython3; same code as python_script
building_cost = Watch(python_script_4)  # graph output
python_script_5 = Python(IN[0]=pairing_area_typologies_with.consultantFee)  # CPython3; same code as python_script
consultant_fee = Watch(python_script_5)  # graph output
python_script_6 = Python(IN[0]=pairing_area_typologies_with.totalCost)  # CPython3; same code as python_script
total_cost = Watch(python_script_6)  # graph output
