# Dynamo graph Terrain Slope Analysis.dyn (Dynamo 3.5.0.8297)
# author: The Dynamo Team
# Display terrain slope from 0 to 45 degrees and above. Blue indicates flatness and red indicates steepness across a gradient, with solid red being 45 degrees or more. Green element indicates selected Analysis center.
# packages: DynamoFormaBeta 4.2.3, MeshToolkit 5.1.0

# group: Inputs
collect_terrain_mesh = GetTerrainHttp("{\"elements\":[{\"urn\":\"urn:adsk-forma-elements:terrain:pro_mnpo1vppxk:50aa3c6e-0ad5-42e6-bce7-ff261facfe0b:1685642880728\",\"path\":\"root/f12768ac-4dcf-4129-b0bc-97ad00d31417\",\"worldTransform\":[1,0,0,0,0,1,0,0,0,0,1,0,0,0,0,1]}],\"region\":\"EMEA\"}")  # graph input
X = DoubleSlider(0, range=-1000..1000 step 0.1)  # graph input
Y = DoubleSlider(0, range=-1000..1000 step 0.1)  # graph input
analysis_size = DoubleSlider(50, range=0..200 step 1)  # graph input

# group: Create Terrain Mesh
# note: Deconstruct Forma VolumeMesh into vertices and indices
volumeMesh = Forma.Elements.Element.VolumeMesh(elements=collect_terrain_mesh)
# note: Generate Dynamo Mesh to analyze
byVerticesAndIndices = Autodesk.Dynamo.MeshToolkit.Mesh.ByVerticesAndIndices(vertices=volumeMesh.vertices, indices=volumeMesh.indices)
firstItem = List.FirstItem(list=byVerticesAndIndices)

# group: Set Analysis on top of Terrain
# note: Collect Terrain elevation at our designated point
elevationAt = Forma.Elements.System.Terrain.ElevationAt(terrain=collect_terrain_mesh, x=X, y=Y)
byCoordinates = Point.ByCoordinates(x=X, y=Y, z=elevationAt)

# group: Make a nice tidy circular slice of terrain
code_block = CodeBlock { 0.05; }
# note: Translate new Mesh up by minimal amount to stop z-fighting issues in Forma Client
translate = Autodesk.Dynamo.MeshToolkit.Mesh.Translate(mesh=firstItem, z=code_block)
code_block_2 = CodeBlock(n=analysis_size) { n/2; }
# note: Generate a Sphere from center point to cover Terrain Analysis to a chosen diameter
sphere = Autodesk.Dynamo.MeshToolkit.Mesh.Sphere(origin=byCoordinates, radius=code_block_2)
# note: Intersect new Terrain with this mesh to pull circular mesh faces out as our Analysis Plane
booleanIntersection = Autodesk.Dynamo.MeshToolkit.Mesh.BooleanIntersection(mesh=translate, tool=sphere)

# group: Translate up to avoid geometry clashing
code_block_3 = CodeBlock { 0.05; }
translate_2 = Autodesk.Dynamo.MeshToolkit.Mesh.Translate(mesh=booleanIntersection, z=code_block_3)

# group: Terrain Angle Analysis
# note: Collect the surface Normal from each triangular Mesh Face
triangleNormals = Autodesk.Dynamo.MeshToolkit.Mesh.TriangleNormals(mesh=booleanIntersection)
ZAxis = Vector.ZAxis()
# note: Calcualte vector angle from Mesh Face and ZAxis base Vector
angleWithVector = Vector.AngleWithVector(vector=triangleNormals, otherVector=ZAxis)

# group: Generate Color Range based on Terrain Angle Analysis
color_palette = ColorPalette({R: 44, G: 123, B: 182, A: 255})
color_palette_2 = ColorPalette({R: 171, G: 217, B: 233, A: 255})
color_palette_3 = ColorPalette({R: 255, G: 255, B: 191, A: 255})
color_palette_4 = ColorPalette({R: 253, G: 174, B: 97, A: 255})
color_palette_5 = ColorPalette({R: 215, G: 25, B: 28, A: 255})
# note: List of colors
list_create = List.Create(item0=color_palette, item1=color_palette_2, item2=color_palette_3, item3=color_palette_4, item4=color_palette_5)
# note: Generate range of Indices
code_block_4 = CodeBlock { 0..1..#5; [0,0.2,0.3,0.6,1]; }
code_block_5 = CodeBlock { 0; 45; 0; 1; }
# note: Remap all Vectors between 0 and 45 to 0 and 1, with any other value above 45 becoming 1
mapTo = Math.MapTo(rangeMin=code_block_5.out0, rangeMax=code_block_5.out1, inputValue=angleWithVector, targetRangeMin=code_block_5.out2, targetRangeMax=code_block_5.out3)
# note: Generate Color Range based on Terrain Angle, with Blue representing flat, ranging through Yellow, Orange and up to Red that indicates more than 45 degree slopes.
color_range = ColorRange(colors=list_create, indices=code_block_4.out0, value=mapTo)

# group: Colorize Mesh Display
# note: Colorize Mesh display based on Color Range
byMeshColor = Autodesk.Dynamo.MeshToolkit.Display.MeshDisplay.ByMeshColor(mesh=translate_2, meshColoring=color_range)
terrain_slope = Watch3D(byMeshColor)  # graph output
